# Dynamo graph 2_MeasureCircularity.dyn (Dynamo 2.10.1.3976)

# group: READ ME
# note: TBC...

# group: Check geometrical volume
code_block = CodeBlock { elem; }  # frozen; unwired: elem
code_block_2 = CodeBlock { "Volume"; }
getParameterValueByName = Element.GetParameterValueByName(element=code_block, parameterName=code_block_2)
sum = Math.Sum(values=getParameterValueByName)
sum_2 = Math.Sum(values=sum)
watch = Watch(sum_2)
geometry = Element.Geometry(element=code_block)  # frozen
flatten = List.Flatten(list=geometry)
volume = Solid.Volume(solid=flatten)
sum_3 = Math.Sum(values=volume)
code_block_3 = CodeBlock(x=sum_3) { x/1000000000; }
watch_2 = Watch(code_block_3)

# group: Get elements from groups
categories = Categories("OST_IOSModelGroups")  # frozen
all_elements_of_category = ElementsOfCategory(Category=categories)
getMembers = Group.GetMembers(group=all_elements_of_category)
flatten_2 = List.Flatten(list=getMembers)
uniqueItems = List.UniqueItems(list=flatten_2)

# group: Collect all elements
code_block_4 = CodeBlock()
# ---------- code_block_4.designscript (12 lines) ----------
[
"Doors",
"Windows",
"Floors",
"Structural Columns",
"Structural Framing",
"Walls",
"Ceilings",
"Columns",
"Roofs",
"Structural Foundations"
];
# ----------------------------------------
include_the_foundations = BoolSelector(true)  # graph input
code_block_5 = CodeBlock { 9; -1; }
if_ = If(test=include_the_foundations, true=code_block_5.out1, false=code_block_5.out0)
removeItemAtIndex = List.RemoveItemAtIndex(list=code_block_4, indices=if_)
byName = Category.ByName(name=removeItemAtIndex)
all_elements_of_category_2 = ElementsOfCategory(Category=byName)
flatten_3 = List.Flatten(list=all_elements_of_category_2)

# group: Take internal unit of measure ID
unit_types = UnitTypes("Area")
py_revit_version = Python()  # IronPython2
# ---------- py_revit_version.python (12 lines) ----------
import clr
clr.AddReference("RevitServices")
import RevitServices
from RevitServices.Persistence import DocumentManager

doc = DocumentManager.Instance.CurrentDBDocument
uiapp = DocumentManager.Instance.CurrentUIApplication
app = uiapp.Application
if int(app.VersionNumber) > 2017: fullVersion = app.SubVersionNumber
else: fullVersion = str(app.VersionNumber)

OUT = app.VersionName, int(app.VersionNumber), app.VersionBuild, app.Language.ToString(), fullVersion
# ----------------------------------------
code_block_6 = CodeBlock(seq=py_revit_version) { version = seq[1]; }
python_script = Python(IN[0]=unit_types, IN[1]=code_block_6)  # IronPython2
# ---------- python_script.python (43 lines) ----------
import clr
clr.AddReference('RevitAPI')
from Autodesk.Revit.DB import *

clr.AddReference("RevitServices")
import RevitServices
from RevitServices.Persistence import DocumentManager
doc = DocumentManager.Instance.CurrentDBDocument

dynunittype = IN[0]
if IN[1] > 2021:
	if str(dynunittype.GetType()) == "Autodesk.Revit.DB.ForgeTypeId":
		unittype = dynunittype
	elif str(dynunittype) == 'DynamoUnits.Area':
		unittype = ForgeTypeId('autodesk.spec.aec:area-2.0.0')
	elif str(dynunittype) == 'DynamoUnits.Length':
		unittype = ForgeTypeId('autodesk.spec.aec:length-2.0.0')
	elif str(dynunittype) == 'DynamoUnits.Volume':
		unittype = ForgeTypeId('autodesk.spec.aec:volume-2.0.0')
	else:
		unittype = None
	formatoptions = doc.GetUnits().GetFormatOptions(unittype)
	dispunits = formatoptions.GetUnitTypeId()
	symtype = formatoptions.GetSymbolTypeId()
	if symtype.TypeId == '': dispsym = None
	else: dispsym = LabelUtils.GetLabelForSymbol(symtype)
else:
	if str(dynunittype.GetType()) == "Autodesk.Revit.DB.UnitType":
		unittype = dynunittype
	elif str(dynunittype) == 'DynamoUnits.Area':
		unittype = UnitType.UT_Area
	elif str(dynunittype) == 'DynamoUnits.Length':
		unittype = UnitType.UT_Length
	elif str(dynunittype) == 'DynamoUnits.Volume':
		unittype = UnitType.UT_Volume
	else:
		unittype = None
	formatoptions = doc.GetUnits().GetFormatOptions(unittype)
	dispunits = formatoptions.DisplayUnits
	symtype = formatoptions.UnitSymbol
	if symtype == UnitSymbolType.UST_NONE: dispsym = None
	else: dispsym = LabelUtils.GetLabelFor(symtype)
OUT = (dispunits,dispsym)
# ----------------------------------------
code_block_7 = CodeBlock(seq=python_script) { displayUnitType = seq[0]; unitSymbol = seq[1]; }
unit_types_2 = UnitTypes("Volume")
python_script_2 = Python(IN[0]=unit_types_2, IN[1]=code_block_6)  # IronPython2; same code as python_script
code_block_8 = CodeBlock(seq=python_script_2) { displayUnitType = seq[0]; unitSymbol = seq[1]; }

# group: Collect info about materials (layers)
code_block_9 = CodeBlock(elem=flatten_3) { elem; }
turn_into_list = CodeBlock(x=code_block_9) { List.Flatten([x]); }
returnPaintMaterials = BoolSelector(false)
py_material_clockwork = Python(IN[0]=turn_into_list, IN[1]=returnPaintMaterials)  # IronPython2
# ---------- py_material_clockwork.python (22 lines) ----------
import clr
clr.AddReference('RevitAPI')
from Autodesk.Revit.DB import *

items = UnwrapElement(IN[0])
paintedmats = IN[1]
elementmats = list()
elementareas = list()
elementvols = list()

for item in items:
	matlist = list()
	arealist = list()
	vollist = list()
	for matid in item.GetMaterialIds(paintedmats):
		matlist.append(item.Document.GetElement(matid))
		arealist.append(item.GetMaterialArea(matid,paintedmats))
		vollist.append(item.GetMaterialVolume(matid))
	elementmats.append(matlist)
	elementareas.append(arealist)
	elementvols.append(vollist)
OUT = (elementmats,elementareas,elementvols)
# ----------------------------------------
code_block_10 = CodeBlock(seq=py_material_clockwork) { seq[0]; seq[1]; seq[2]; }
code_block_11 = CodeBlock(value=code_block_10.out1, displayUnitType=code_block_7.displayUnitType, RevitVersion=code_block_6) { value; displayUnitType; RevitVersion; }
py_internalunit_todisplayunit = Python(IN[0]=code_block_11.value, IN[1]=code_block_11.displayUnitType, IN[2]=code_block_11.RevitVersion)  # "Py InternalUnit.ToDisplayUnit (Clockwork)"; IronPython2
# ---------- py_internalunit_todisplayunit.python (26 lines) ----------
import clr
clr.AddReference('RevitAPI')
from Autodesk.Revit.DB import *

def FromInternalUnits(val, unittype):
	if (version > 2021 and str(dispunit.GetType()) == "Autodesk.Revit.DB.ForgeTypeId") or (version < 2022 and str(dispunit.GetType()) == "Autodesk.Revit.DB.DisplayUnitType"):
		return UnitUtils.ConvertFromInternalUnits(val,unittype)
	else: return None

vals = IN[0]
dispunit = IN[1]
version = IN[2]

# turn into list of lists:
if not isinstance(vals[0], list):
    vals = [vals]
if not isinstance(vals[0], list):
    vals = [vals]

OUT = []

for list in vals:
	inner = []
	for x in list:
		inner.append(FromInternalUnits(x, dispunit))
	OUT.append(inner)
# ----------------------------------------
py_returnlistorsinglevalue = Python(IN[0]=code_block_9, IN[1]=py_internalunit_todisplayunit)  # IronPython2
# ---------- py_returnlistorsinglevalue.python (4 lines) ----------
check = IN[0]
items = IN[1]
if isinstance(check, (list)): OUT = items
else: OUT = items[0]
# ----------------------------------------
code_block_12 = CodeBlock(materialAreas=py_returnlistorsinglevalue) { materialAreas; }  # frozen
isEmpty = List.IsEmpty()  # unwired: list
map = List.Map(list=code_block_10.out0, function=isEmpty)
not_ = Not(x=map)
py_returnlistorsinglevalue_2 = Python(IN[0]=code_block_9, IN[1]=not_)  # IronPython2; same code as py_returnlistorsinglevalue
code_block_13 = CodeBlock(hasMaterial=py_returnlistorsinglevalue_2) { hasMaterial; }
py_returnlistorsinglevalue_3 = Python(IN[0]=code_block_9, IN[1]=code_block_10.out0)  # IronPython2; same code as py_returnlistorsinglevalue
code_block_14 = CodeBlock(materials=py_returnlistorsinglevalue_3) { materials; }
name = Material.Name(material=code_block_14)
code_block_15 = CodeBlock(value=code_block_10.out2, displayUnitType=code_block_8.displayUnitType, RevitVersion=code_block_6) { value; displayUnitType; RevitVersion; }
py_internalunit_todisplayunit_2 = Python(IN[0]=code_block_15.value, IN[1]=code_block_15.displayUnitType, IN[2]=code_block_15.RevitVersion)  # "Py InternalUnit.ToDisplayUnit (Clockwork)"; IronPython2; same code as py_internalunit_todisplayunit
py_returnlistorsinglevalue_4 = Python(IN[0]=code_block_9, IN[1]=py_internalunit_todisplayunit_2)  # IronPython2; same code as py_returnlistorsinglevalue
code_block_16 = CodeBlock(materialVolumes=py_returnlistorsinglevalue_4) { materialVolumes; }

# group: Load mapping data and code
string = StringInput(".\snippets\Map_names.py")
file_from_path = FileObject(path=string)
readText = FileSystem.ReadText(file=file_from_path)
string_2 = StringInput(".\data\Material_mapping.json")
file_from_path_2 = FileObject(path=string_2)
readText_2 = FileSystem.ReadText(file=file_from_path_2)

# group: Match materials
code_block_17 = CodeBlock(materials=name) { materials; }
watch_3 = Watch(code_block_17)
py_match_material_names = PythonStringNode(script=readText, IN[0]=readText_2, IN[1]=watch_3)  # CPython3
watch_4 = Watch(py_match_material_names)

# group: Split RC into steel and concrete (using constant ratio)
code_block_18 = CodeBlock(materials=watch_4, volumes=code_block_16) { materials; volumes; steel_concrete_ratio = 0.025; }
python_script_3 = Python(IN[0]=code_block_18.materials, IN[1]=code_block_18.volumes, IN[2]=code_block_18.steel_concrete_ratio)  # CPython3
# ---------- python_script_3.python (26 lines) ----------
# Load the Python Standard and DesignScript Libraries
import sys
import clr
clr.AddReference('ProtoGeometry')
from Autodesk.DesignScript.Geometry import *
from copy import deepcopy

materials = IN[0]
volumes = IN[1]
steel_concrete_ratio = IN[2]

new_materials = deepcopy(materials)
new_volumes = deepcopy(volumes)

for i in range(len(materials)):
    for j in range(len(materials[i])):
        if materials[i][j] == "Concrete":
            new_volumes[i][j] = volumes[i][j] * (1-steel_concrete_ratio)
            if "Steel" in materials[i]:
                steel_id = materials[i].index("Steel")
                new_volumes[i][steel_id] = volumes[i][j]*steel_concrete_ratio
            else:
                new_materials[i].append("Steel")
                new_volumes[i].append(volumes[i][j]*steel_concrete_ratio)

OUT = [new_materials, new_volumes, volumes[i][j]]
# ----------------------------------------
code_block_19 = CodeBlock(seq=python_script_3) { materials = seq[0]; volumes = seq[1]; }

watch_5 = Watch(code_block_19.materials)
watch_6 = Watch(code_block_19.volumes)

# group: Filter by volume
code_block_20 = CodeBlock(material_name=watch_5, material_volume=watch_6) { material_name; material_volume; }
sum_4 = Math.Sum(values=code_block_20.material_volume)
code_block_21 = CodeBlock { 0; 0.0001; }
eq = Equals(x=sum_4, y=code_block_21.out0, tolerance=code_block_21.out1)
filterByBoolMask = List.FilterByBoolMask(list=code_block_20.material_volume, mask=eq)
code_block_22 = CodeBlock { 0; 0.0001; }
eq_2 = Equals(x=filterByBoolMask.out, y=code_block_22.out0, tolerance=code_block_22.out1)
filterByBoolMask_2 = List.FilterByBoolMask(list=filterByBoolMask.out, mask=eq_2)
flatten_4 = List.Flatten(list=filterByBoolMask_2.out)
filterByBoolMask_3 = List.FilterByBoolMask(list=code_block_20.material_name, mask=eq)
filterByBoolMask_4 = List.FilterByBoolMask(list=filterByBoolMask_3.out, mask=eq_2)
flatten_5 = List.Flatten(list=filterByBoolMask_4.out)
count = List.Count(list=filterByBoolMask_2.out, lacing=Longest)
code_block_23 = CodeBlock(elements=flatten_3) { elements; }
filterByBoolMask_5 = List.FilterByBoolMask(list=code_block_23, mask=eq)
code_block_24 = CodeBlock(elements=filterByBoolMask_5.out) { elements; }

# group: Load input data
string_3 = StringInput(".\data\Material_data.json")
file_from_path_3 = FileObject(path=string_3)
readText_3 = FileSystem.ReadText(file=file_from_path_3)
parseJSON = Data.ParseJSON(json=readText_3)
watch_7 = Watch(parseJSON)

# group: Material Circularity Indicator calculations
code_block_25 = CodeBlock()
# ---------- code_block_25.designscript (2 lines) ----------
//Product utility
X=1;
# ----------------------------------------
code_block_26 = CodeBlock(volume=flatten_4) { volume; }
code_block_27 = CodeBlock(data=watch_7, material=flatten_5)
# ---------- code_block_27.designscript (18 lines) ----------
Dictionary.ValueAtKey(Dictionary.ValueAtKey(data, material), "C_R");
Dictionary.ValueAtKey(Dictionary.ValueAtKey(data, material), "C_U");
Dictionary.ValueAtKey(Dictionary.ValueAtKey(data, material), "C_C");

Dictionary.ValueAtKey(Dictionary.ValueAtKey(data, material), "E_R");
Dictionary.ValueAtKey(Dictionary.ValueAtKey(data, material), "HHV");
Dictionary.ValueAtKey(Dictionary.ValueAtKey(data, material), "M_B");

Dictionary.ValueAtKey(Dictionary.ValueAtKey(data, material), "B_C");

Dictionary.ValueAtKey(Dictionary.ValueAtKey(data, material), "E_F");
Dictionary.ValueAtKey(Dictionary.ValueAtKey(data, material), "E_C");

Dictionary.ValueAtKey(Dictionary.ValueAtKey(data, material), "Density");

Dictionary.ValueAtKey(Dictionary.ValueAtKey(data, material), "F_R");
Dictionary.ValueAtKey(Dictionary.ValueAtKey(data, material), "F_U");
Dictionary.ValueAtKey(Dictionary.ValueAtKey(data, material), "F_S");
# ----------------------------------------
code_block_28 = CodeBlock(volume=code_block_26, density=code_block_27.out9)
# ---------- code_block_28.designscript (2 lines) ----------
//Mass
M=volume*density;
# ----------------------------------------
code_block_29 = CodeBlock(M=code_block_28, F_R=code_block_27.out10, F_U=code_block_27.out11, F_S=code_block_27.out12)
# ---------- code_block_29.designscript (2 lines) ----------
//Amount of virgin material
V = M*(1-F_R-F_U-F_S);
# ----------------------------------------
code_block_30 = CodeBlock(E_R=code_block_27.out3, HHV=code_block_27.out4, M_B=code_block_27.out5)
# ---------- code_block_30.designscript (6 lines) ----------
//efficiency of the
//energy recovery process
//E_E = E_R/(HHV*M_B);
E_R;
HHV;
M_B;
# ----------------------------------------
py_e_e = Python(IN[0]=code_block_30.E_R, IN[1]=code_block_30.HHV, IN[2]=code_block_30.M_B)  # IronPython2
# ---------- py_e_e.python (11 lines) ----------
E_R = IN[0]
HHV = IN[1]
M_B = IN[2]

OUT = []

for i in range(len(IN[0])):
	try:
		OUT.append(E_R[i]/(HHV[i]*M_B[i]))
	except ZeroDivisionError:
		OUT.append(0)
# ----------------------------------------
code_block_31 = CodeBlock(E_E=py_e_e, B_C=code_block_27.out6)
# ---------- code_block_31.designscript (4 lines) ----------
//Fraction of mass of a product being collected
//for energy recovery where the material
//satisfies the requirements for inclusion
C_E = E_E*B_C;
# ----------------------------------------
code_block_32 = CodeBlock(M=code_block_28, C_R=code_block_27.out0, C_U=code_block_27.out1, C_C=code_block_27.out2, C_E=code_block_31)
# ---------- code_block_32.designscript (2 lines) ----------
//Waste from the linear flow Wj
W_0 = M*(1-C_R-C_U-C_C-C_E);
# ----------------------------------------
code_block_33 = CodeBlock(M=code_block_28, F_R=code_block_27.out10, E_F=code_block_27.out7)
# ---------- code_block_33.designscript (7 lines) ----------
//Waste to produce any recycled
//content used as feedstock in
//the  recycling process
//W_F = M*F_R*(1-E_F)/E_F;
M;
F_R;
E_F;
# ----------------------------------------
py_w_f = Python(IN[0]=code_block_33.M, IN[1]=code_block_33.F_R, IN[2]=code_block_33.E_F)  # IronPython2
# ---------- py_w_f.python (11 lines) ----------
M = IN[0]
F_R = IN[1]
E_F = IN[2]

OUT = []

for i in range(len(IN[0])):
	try:
		OUT.append(M[i]*F_R[i]*(1-E_F[i])/E_F[i])
	except ZeroDivisionError:
		OUT.append(0)
# ----------------------------------------
code_block_34 = CodeBlock(M=code_block_28, E_C=code_block_27.out8, C_R=code_block_27.out0)
# ---------- code_block_34.designscript (2 lines) ----------
//Waste generated in the  recycling process Wj
W_C = M*(1-E_C)*C_R;
# ----------------------------------------
code_block_35 = CodeBlock(W_0=code_block_32, W_F=py_w_f, W_C=code_block_34)
# ---------- code_block_35.designscript (2 lines) ----------
//Amount of unrecoverable waste
W = W_0+(W_F+W_C)/2;
# ----------------------------------------
code_block_36 = CodeBlock(V=code_block_29, W=code_block_35, M=code_block_28)
# ---------- code_block_36.designscript (2 lines) ----------
//Linear Flow Index
LFI = (V+W)/(2*M);
# ----------------------------------------
code_block_37 = CodeBlock(X=code_block_25, LFI=code_block_36)
# ---------- code_block_37.designscript (2 lines) ----------
//Material Circularity Indicator
MCI = 1-(0.9/X*LFI);
# ----------------------------------------
code_block_38 = CodeBlock { 0; }
ge = code_block_37 >= code_block_38
if_2 = If(test=ge, true=code_block_37, false=code_block_38)
code_block_39 = CodeBlock(MCI=if_2) { MCI; }
code_block_40 = CodeBlock(elements=code_block_24, count=count) { elements; count; }
code_block_41 = CodeBlock(elements=code_block_40.elements, count=code_block_40.count) { elements; count; }
ofRepeatedItem = List.OfRepeatedItem(item=code_block_41.elements, amount=code_block_41.count, lacing=Longest)
flatten_6 = List.Flatten(list=ofRepeatedItem)
id = Element.Id(element=flatten_6)
getCategory = Element.GetCategory(element=flatten_6)
code_block_42 = CodeBlock { "Type"; }
getParameterValueByName_2 = Element.GetParameterValueByName(element=flatten_6, parameterName=code_block_42)
code_block_43 = CodeBlock { "Type Name"; }
getParameterValueByName_3 = Element.GetParameterValueByName(element=getParameterValueByName_2, parameterName=code_block_43)
code_block_44 = CodeBlock(product_id=id, product_category=getCategory, product_name=getParameterValueByName_3, material_name=flatten_5, material_volume=code_block_26, material_density=code_block_27.out9, material_weight=code_block_28, V=code_block_29, F_R=code_block_33.F_R, F_U=code_block_27.out11, F_S=code_block_27.out12, C_R=code_block_27.out0, C_U=code_block_27.out1, W_0=code_block_32, Linear_flow_index=code_block_36, MCI=code_block_39)
# ---------- code_block_44.designscript (18 lines) ----------
[
product_id,
product_category,
product_name,
material_name,
material_volume,
material_density,
material_weight,
V,
F_R,
F_U,
F_S,
C_R,
C_U,
W_0,
Linear_flow_index,
MCI
];
# ----------------------------------------

# group: Load mapping data and code
string_4 = StringInput(".\snippets\Disassembly_indicator.py")
file_from_path_4 = FileObject(path=string_4)
readText_4 = FileSystem.ReadText(file=file_from_path_4)
string_5 = StringInput(".\data\Disassembly_data.json")
file_from_path_5 = FileObject(path=string_5)
readText_5 = FileSystem.ReadText(file=file_from_path_5)

# group: Calculate Disassembly Index
code_block_45 = CodeBlock(elements=code_block_24) { elements; }
code_block_46 = CodeBlock()
# ---------- code_block_46.designscript (4 lines) ----------
["Connection type",
"Connection accessibility",
"Crossings",
"Form containment"];
# ----------------------------------------
getParameterValueByName_4 = Element.GetParameterValueByName(element=code_block_45, parameterName=code_block_46, lacing=CrossProduct)
python_script_from_string = PythonStringNode(script=readText_4, IN[0]=getParameterValueByName_4, IN[1]=readText_5)  # IronPython2
code_block_47 = CodeBlock(DI=python_script_from_string)
# ---------- code_block_47.designscript (3 lines) ----------
//Disassembly index
DI;
//(the higher the better, max 4.0, min 0.4)
# ----------------------------------------

# group: Product Circularity Indicator calculations
code_block_48 = CodeBlock(MCI=code_block_39) { MCI; }
code_block_49 = CodeBlock(count=count) { count; }
chop = List.Chop(list=code_block_48, lengths=code_block_49)
code_block_50 = CodeBlock(M=code_block_28)
# ---------- code_block_50.designscript (2 lines) ----------
//Mass
M;
# ----------------------------------------
chop_2 = List.Chop(list=code_block_50, lengths=code_block_49)
sum_5 = Math.Sum(values=chop_2)
code_block_51 = CodeBlock(Mj=sum_5) { Mj; }
code_block_52 = CodeBlock(elements=code_block_45) { elements; }
id_2 = Element.Id(element=code_block_52)
getCategory_2 = Element.GetCategory(element=code_block_52)
code_block_53 = CodeBlock { "Type"; }
getParameterValueByName_5 = Element.GetParameterValueByName(element=code_block_52, parameterName=code_block_53)
code_block_54 = CodeBlock { "Type Name"; }
getParameterValueByName_6 = Element.GetParameterValueByName(element=getParameterValueByName_5, parameterName=code_block_54)
code_block_55 = CodeBlock(DI=code_block_47)
# ---------- code_block_55.designscript (2 lines) ----------
//Disassembly index
DI;
# ----------------------------------------

mul = chop * chop_2

# group (continued): Product Circularity Indicator calculations
sum_6 = Math.Sum(values=mul)

div = sum_6 / sum_5

# group (continued): Product Circularity Indicator calculations
code_block_56 = CodeBlock(temp=div, DI=code_block_47)
# ---------- code_block_56.designscript (2 lines) ----------
//Product Circularity Indicator
PCI = temp*DI/4;
# ----------------------------------------
code_block_57 = CodeBlock(product_id=id_2, product_category=getCategory_2, product_name=getParameterValueByName_6, product_volume=sum_5, Disassembly_ind=code_block_47, PCI=code_block_56)
# ---------- code_block_57.designscript (8 lines) ----------
[
product_id,
product_category,
product_name,
product_volume,
Disassembly_ind,
PCI
];
# ----------------------------------------

# group: System Circularity Indicator calculations
code_block_58 = CodeBlock(PCI=code_block_56, Mj=code_block_51) { temp = PCI*Mj; }
code_block_59 = CodeBlock(elements=code_block_24) { elements; }
getCategory_3 = Element.GetCategory(element=code_block_59)
groupByKey = List.GroupByKey(list=code_block_58, keys=getCategory_3)
sum_7 = Math.Sum(values=groupByKey.groups)
code_block_60 = CodeBlock(Mj=code_block_51) { Mj; }
groupByKey_2 = List.GroupByKey(list=code_block_60, keys=getCategory_3)
sum_8 = Math.Sum(values=groupByKey_2.groups)
code_block_61 = CodeBlock(temp=sum_7, Ms=sum_8)
# ---------- code_block_61.designscript (3 lines) ----------
//System Circularity Indicator
// SCI = PCI*Mj/Ms;
SCI = temp/Ms;
# ----------------------------------------
groupByKey_3 = List.GroupByKey(list=code_block_59, keys=getCategory_3)
watch_8 = Watch(groupByKey_3.unique_keys)

# group: Building Circularity Indicator calculations
code_block_62 = CodeBlock(elements=code_block_24) { elements; }
code_block_63 = CodeBlock { "Building layer"; }
getParameterValueByName_7 = Element.GetParameterValueByName(element=code_block_62, parameterName=code_block_63, lacing=Longest)
getCategory_4 = Element.GetCategory(element=code_block_62)
groupByKey_4 = List.GroupByKey(list=getParameterValueByName_7, keys=getCategory_4)
watch_9 = Watch(groupByKey_4.groups)
average = Math.Average(numbers=watch_9)
watch_10 = Watch(average)
code_block_64 = CodeBlock(SCI=code_block_61, BL=watch_10)
# ---------- code_block_64.designscript (5 lines) ----------
//Building Circularity Indicator
//LK = 0.1+0.2+0.7+0.8+0.9+1.0;
//We take only Structure+Skin+SpacePlan
LK = 0.2+0.7+0.9;
BCI = Math.Sum(SCI*BL)/LK;
# ----------------------------------------

code_block_65 = CodeBlock(MCI=code_block_39, PCI=code_block_56, SCI=code_block_61, BCI=code_block_64.BCI) { MCI; PCI; SCI; BCI; }

# group: Save results to parameter
code_block_66 = CodeBlock { "Material Circularity Indicator"; }
code_block_67 = CodeBlock(MCI=code_block_65.MCI, PCI=code_block_65.PCI, SCI=code_block_65.SCI, BCI=code_block_65.BCI) { MCI; PCI; SCI; BCI; }
setParameterByName = Element.SetParameterByName(parameterName=code_block_66, value=code_block_67.MCI)  # frozen; unwired: element
code_block_68 = CodeBlock(elements=code_block_24) { elements; }
code_block_69 = CodeBlock { "Product Circularity Indicator"; }
setParameterByName_2 = Element.SetParameterByName(element=code_block_68, parameterName=code_block_69, value=code_block_67.PCI)
code_block_70 = CodeBlock { "System Circularity Indicator"; }
setParameterByName_3 = Element.SetParameterByName(parameterName=code_block_70, value=code_block_67.SCI)  # frozen; unwired: element
categories_2 = Categories("OST_ProjectInformation")
all_elements_of_category_3 = ElementsOfCategory(Category=categories_2)
code_block_71 = CodeBlock(i=all_elements_of_category_3) { i[0]; }
code_block_72 = CodeBlock { "Building Circularity Indicator"; }
setParameterByName_4 = Element.SetParameterByName(element=code_block_71, parameterName=code_block_72, value=code_block_67.BCI)

string_6 = StringInput(".\data\Lifespan_expectancy.json")
file_from_path_6 = FileObject(path=string_6)
readText_6 = FileSystem.ReadText(file=file_from_path_6)

# group: Display circularity results in UI
code_block_73 = CodeBlock(PCI=code_block_65.PCI, SCI=code_block_65.SCI, BCI=code_block_65.BCI, categories=watch_8) { PCI; SCI; BCI; categories; }
average_2 = Math.Average(numbers=code_block_73.PCI)
code_block_74 = CodeBlock(x=average_2) { "Your average Product Circularity Indicator is: "+x+"."; }
product_circularity_indicator = Watch(code_block_74)  # "Product Circularity Indicator score"; graph output
code_block_75 = CodeBlock(BCI=code_block_73.BCI) { "Your Building Circularity Indicator is: "+BCI+"."; }
building_circularity_indicator = Watch(code_block_75)  # "Building Circularity Indicator score"; graph output
code_block_76 = CodeBlock { "System Circularity Indicator is:"; }
code_block_77 = CodeBlock(SCI=code_block_73.SCI, cat=code_block_73.categories) { " "+Math.Round(SCI, 2)+" for "+cat; }
code_block_78 = CodeBlock { 4; 4; }
remove = String.Remove(string=code_block_77, startIndex=code_block_78.out0, count=code_block_78.out1)
join = List.Join(list0=code_block_76, list1=remove)
string_from_array = FromArray(array=join)
code_block_79 = CodeBlock { 0; 1; }
remove_2 = String.Remove(string=string_from_array, startIndex=code_block_79.out0, count=code_block_79.out1)
code_block_80 = CodeBlock { -1; 1; }
remove_3 = String.Remove(string=remove_2, startIndex=code_block_80.out0, count=code_block_80.out1)
code_block_81 = CodeBlock { 32; 1; }
remove_4 = String.Remove(string=remove_3, startIndex=code_block_81.out0, count=code_block_81.out1)
system_circularity_indicator = Watch(remove_4)  # "System Circularity Indicator score"; graph output

# group: TODO
code_block_82 = CodeBlock()  # // Compute volumes for non volumetric elements (now foundations fail!)

# group: Product Utility (not in use?)
code_block_83 = CodeBlock { (L_j/L_av_j)*(U_j/U_av_j); }  # frozen; unwired: L_j, L_av_j, U_j, U_av_j

average_3 = Math.Average(numbers=code_block_61)
code_block_84 = CodeBlock(BCI=code_block_64.BCI, SCI=average_3)
# ---------- code_block_84.designscript (4 lines) ----------
[
BCI,
SCI
];
# ----------------------------------------
categories_3 = Categories("OST_ProjectInformation")
all_elements_of_category_4 = ElementsOfCategory(Category=categories_3)
code_block_85 = CodeBlock(i=all_elements_of_category_4) { i[0]; }
code_block_86 = CodeBlock()
# ---------- code_block_86.designscript (5 lines) ----------
[
"Project Name",
"Project Address",
"Author"
];
# ----------------------------------------
getParameterValueByName_8 = Element.GetParameterValueByName(element=code_block_85, parameterName=code_block_86)

# group: Generate Excel report
excel_template_file_location = StringInput(".\template\Template_Excel_report.xlsx")
file_from_path_7 = FileObject(path=excel_template_file_location)
excel_report_directory_path = Directory("C:\Users\arturbt\Desktop\Temp")  # graph input
string_7 = StringInput("\")
excel_report_file_name = StringInput("MyCircularityReport")  # graph input
string_8 = StringInput(".xlsx")
concat = String.Concat(string0=excel_report_directory_path, string1=string_7, string2=excel_report_file_name, string3=string_8)
boolean = BoolSelector(true)
copyFile = FileSystem.CopyFile(file=file_from_path_7, destinationPath=concat, overwrite=boolean)
if_3 = If(test=copyFile, true=concat, false=concat)
code_block_87 = CodeBlock()
# ---------- code_block_87.designscript (4 lines) ----------
["MCI_results",
"PCI_results",
"Report",
"Report"];
# ----------------------------------------
code_block_88 = CodeBlock { [1,1,14,0]; [0,0,3,1]; }
code_block_89 = CodeBlock(MCI_data=code_block_44, PCI_data=code_block_57, Report_data=code_block_84, Project_name=getParameterValueByName_8) { MCI_data; PCI_data; Report_data; Project_name; }
transpose = List.Transpose(lists=code_block_89.MCI_data)
transpose_2 = List.Transpose(lists=code_block_89.PCI_data)
transpose_3 = List.Transpose(lists=code_block_89.Report_data)
transpose_4 = List.Transpose(lists=code_block_89.Project_name)
list_create = List.Create(item0=transpose, item1=transpose_2, item2=transpose_3, item3=transpose_4)
code_block_90 = CodeBlock(data=list_create) { data; }
boolean_2 = BoolSelector(false)
exportExcel = Data.ExportExcel(filePath=if_3, sheetName=code_block_87, startRow=code_block_88.out0, startCol=code_block_88.out1, data=code_block_90, overWrite=boolean_2)

# group: Info display
isEmpty_2 = List.IsEmpty(list=exportExcel)
code_block_91 = CodeBlock(path=if_3) { "You're data was succesfully exported to Excel: "+path; "There was a problem exporting your Excel data."; }
if_4 = If(test=isEmpty_2, true=code_block_91.out1, false=code_block_91.out0)
export_result = Watch(if_4)  # graph output

code_block_92 = CodeBlock()  # //TODO: should take from parameter
